# Grasshopper definition Twist.ghx (Grasshopper 1.0.8)

geomin = Geometry(<extrusion referenced from the Rhino model>)
bbox = BoundingBox(Content=geomin, Plane=PlaneXY(0, 0, 0))  # -> Box, Box_2
debox = DeconstructBox(Box=bbox.Box)  # -> Plane, X, Y, Z
Z = UnitZ(Factor=1)
move = Move(Geometry=debox.Plane, Motion=Z)  # -> Geometry, Transform
rad = Radians(Degrees=Slider(19, range=0..360))
ln = Line(StartPoint=debox.Plane, EndPoint=move.Geometry)
twist = Twist(Geometry=geomin, Axis=ln, Angle=rad, Infinite=True, Rigid=False)
geomout = Geometry(twist)
